# Grasshopper definition ORIGAMI.gh (Grasshopper 1.0.7)

# RECTANGLE
number_slider = Slider(8.5, range=0..10)
number_slider_2 = Slider(0.15, range=0..0.25)
rectangle = Rectangle(Plane=PlaneXY(0, 0, 0), XSize=number_slider, YSize=number_slider, Radius=0)  # -> Rectangle, Length
# DIVIDING POINTS
divide = DivideCurve(Curve=rectangle.Rectangle, Count=Slider(8, range=0..10), Kinks=False)  # -> Points, Tangents, Parameters
item = ListItem(List=divide.Points, Index=0, Wrap=True)  # -> Item, Item1, Item2, Item3, Item4, Item5, Item6, Item7
points = PointList(Points=divide.Points, Size=Slider(1, range=0..1))

subtraction = Subtraction(A="1", B=number_slider_2)

# ----
# LOWER POINT
panel = Panel("6")
dom = ConstructDomain(DomainStart="0", DomainEnd=panel)
# CENTER POINT
# REMAP
dom_2 = ConstructDomain(DomainStart="0", DomainEnd="0.25")
remap = RemapNumbers(Value=number_slider_2, Source=dom_2, Target=dom)  # -> Mapped, Clipped
# CENTER POINT
area = Area(Geometry=rectangle.Rectangle)  # -> Area, Centroid
Z = UnitZ(Factor=remap.Mapped)
# CENTER POINT MOTION
move = Move(Geometry=area.Centroid, Motion=Z)  # -> Geometry, Transform

# ----
# SLIDING POINT
panel_2 = Panel("0.9")
dom_3 = ConstructDomain(DomainStart=panel_2, DomainEnd="0")
ln = Line(StartPoint=area.Centroid, EndPoint=item.Item2)
remap_2 = RemapNumbers(Value=number_slider_2, Source=dom_2, Target=dom_3)  # -> Mapped, Clipped
eval = EvaluateCurve(Curve=ln, Parameter=remap_2.Mapped)  # -> Point, Tangent, Angle

# ----
# TIC MARKS
# VERTICAL LINE
ln_2 = Line(StartPoint=item.Item1, EndPoint=item.Item5)
eval_2 = EvaluateCurve(Curve=ln_2, Parameter=number_slider_2)  # -> Point, Tangent, Angle
eval_3 = EvaluateCurve(Curve=ln_2, Parameter=subtraction)  # -> Point, Tangent, Angle
ln_3 = Line(StartPoint=eval_2.Point, EndPoint=item.Item2)
ln_4 = Line(StartPoint=eval_2.Point, EndPoint=item.Item)
ln_5 = Line(StartPoint=eval_3.Point, EndPoint=item.Item4)
ln_6 = Line(StartPoint=eval_3.Point, EndPoint=item.Item6)

# ----
# REMAP
dom_4 = ConstructDomain(DomainStart="0", DomainEnd="4")
remap_3 = RemapNumbers(Value=number_slider_2, Source=dom_2, Target=dom_4)  # -> Mapped, Clipped
# CENTER POINT MOTION
Z_2 = UnitZ(Factor=remap_3.Mapped)
move_2 = Move(Geometry=eval_2.Point, Motion=Z_2)  # -> Geometry, Transform

# ----
# HORIZONTAL LINE
ln_7 = Line(StartPoint=item.Item3, EndPoint=item.Item7)
eval_4 = EvaluateCurve(Curve=ln_7, Parameter=subtraction)  # -> Point, Tangent, Angle
eval_5 = EvaluateCurve(Curve=ln_7, Parameter=number_slider_2)  # -> Point, Tangent, Angle
ln_8 = Line(StartPoint=eval_5.Point, EndPoint=item.Item4)
ln_9 = Line(StartPoint=eval_4.Point, EndPoint=item.Item)
ln_10 = Line(StartPoint=eval_5.Point, EndPoint=item.Item2)
ln_11 = Line(StartPoint=eval_4.Point, EndPoint=item.Item6)

srf4pt = _4PointSurface(CornerA=move.Geometry, CornerB=move_2.Geometry, CornerC=eval.Point)

# ----
# MIRROR
pl_3pt = Plane3Pt(PointA=eval.Point, PointB=area.Centroid, PointC=move.Geometry)
pln = Plane(area.Centroid)

# ----
# SURFACES
mirror = Mirror(Geometry=srf4pt, Plane=pl_3pt)  # -> Geometry, Transform

join = BrepJoin(Breps=[srf4pt, mirror.Geometry])  # -> Breps, Closed
arrpolar = PolarArray(Geometry=join.Breps, Plane=pln, Count=Slider(4, range=0..10), Angle=6.283185307)  # -> Geometry, Transform
