# Grasshopper definition chair.gh (Grasshopper 1.0.7)

R = Rail(reparameterize(<rail referenced from the Rhino model>))
pt = Point([<point referenced from the Rhino model> x4])
S = Sections([<sections referenced from the Rhino model> x4])
pframe = PerpFrame(Curve=R, Parameter=[Slider(0.58, range=0..1), Slider(0.28, range=0..1), Slider(0, range=0..1), Slider(1, range=0..1)])
xy = XYPlane(Origin=pt)
orient = Orient(Geometry=S, Source=xy, Target=pframe)  # -> Geometry, Transform
swp1 = Sweep1(Rail=R, Sections=orient.Geometry, Miter=1)
pframes = PerpFrames(Curve=R, Count=Slider(30, range=0..100), Align=True)  # -> Frames, Parameters
sec = BrepPlane(Brep=swp1, Plane=pframes.Frames)  # -> Curves, Points
srf = Surface(sec.Curves)
