# Grasshopper definition pattern.gh (Grasshopper 1.0.7)

md_slider = MDSlider(SliderMode=0, slider_value=Point(0.5, 0.5, 0.5), x_domain=Domain(0, 1), y_domain=Domain(0, 1), z_domain=Domain(0, 1))
sqgrid = Square(
    Plane=PlaneXY(0, 0, 0),
    Size=Slider(12.5, range=0..100),
    ExtentX=Slider(10, range=3..15),
    ExtentY=Slider(10, range=3..15))  # -> Cells, Points
bbox = BoundingBox(Content=sqgrid.Cells, Plane=PlaneXY(0, 0, 0), UnionBox=True)  # -> Box, Box_2
evalsrf = EvaluateSurface(Surface=reparameterize(bbox.Box), Point=md_slider)  # -> Point, Normal, UDirection, VDirection, Frame
explode = Explode(Curve=sqgrid.Cells, Recursive=True)  # -> Segments, Vertices
number_slider = Slider(0.85, range=0..1)
item = ListItem(List=explode.Vertices, Index=0, Wrap=True)  # -> Item, Item1
item_2 = ListItem(List=explode.Segments, Index=0, Wrap=True)  # -> Item, Item1
curvepoint = PointOnCurve(item_2.Item, parameter=0.5)
Z = UnitZ(Factor=1)
area = Area(Geometry=sqgrid.Cells)  # -> Area, graft(Centroid)
ln = Line(StartPoint=area.Centroid, EndPoint=item.Item1)
cp = ClosestPoint(Point=area.Centroid, Cloud=evalsrf.Point)  # -> ClosestPoint, CPIndex, flatten(Distance)
flip = FlipCurve(Curve=item_2.Item1)  # -> Curve, Flag
pl = ConstructPlane(Origin=area.Centroid, XAxis=ln, YAxis=Z)
eval = EvaluateCurve(Curve=reparameterize(flip.Curve), Parameter=number_slider)  # -> Point, Tangent, Angle
eval_2 = EvaluateCurve(Curve=reparameterize(item_2.Item), Parameter=number_slider)  # -> Point, Tangent, Angle
number_slider_2 = Slider(6.1, range=0..10)
ln_2 = Line(StartPoint=curvepoint, EndPoint=area.Centroid)
X = UnitX(Factor=1)
eval_3 = EvaluateCurve(Curve=reparameterize(ln_2), Parameter=Slider(1, range=0..1))  # -> Point, Tangent, Angle
X_2 = UnitX(Factor=expr("-x", number_slider_2))
X_3 = UnitX(Factor=number_slider_2)
arc = ArcSED(Start=eval_2.Point, End=eval.Point, Direction=X)  # -> Arc, Plane, Radius
bzspan = BezierSpan(StartPoint=eval_3.Point, StartTangent=X_3, EndPoint=eval_2.Point, EndTangent=X_2)  # -> Curve, Length, Domain
mirror = Mirror(Geometry=bzspan.Curve, Plane=pl)  # -> Geometry, Transform
join = JoinCurves(Curves=[arc.Arc, bzspan.Curve, mirror.Geometry], Preserve=False)
arrpolar = PolarArray(Geometry=join, Plane=area.Centroid, Count=Slider(5, range=0..10), Angle=6.283185307)  # -> Geometry, Transform
join_2 = JoinCurves(Curves=arrpolar.Geometry, Preserve=False)
Z_2 = UnitZ(Factor=1)
extr = Extrude(Base=join_2, Direction=Z_2)
