# Grasshopper definition shell.gh (Grasshopper 1.0.7)

# ----
# Arc
number_slider = Slider(5, range=0..100)
number_slider_2 = Slider(31, range=0..100)
series = Series(Start=Slider(81, range=0..100), Step=number_slider, Count=number_slider_2)

# ----
# Rotation
dom = ConstructDomain(DomainStart=0, DomainEnd=Slider(190, range=0..1000))
range = Range(Domain=dom, Steps=number_slider_2)
xz = XZPlane(Origin=Point(0, 0, 0))
rotate = Rotate(Geometry=xz, Angle=degrees(range), Plane=PlaneXY(0, 0, 0))  # -> Geometry, Transform

arc = Arc(Plane=rotate.Geometry, Radius=series, Angle=Domain(0, 3.141592654))  # -> Arc, Length

pipe = Pipe(Curve=arc.Arc, Radius=expr("x/2", number_slider), Caps=0)
loft = Loft(Curves=arc.Arc, Options={Adjust=False, Closed=False, LoftEnds=0, LoftSimp=0, LoftType=0, Rebuild=10, Refit=0.01})
preview = CustomPreview(Geometry=loft, Material=ColourSwatch(SwatchColor=RGB(255, 0, 144)))
preview_2 = CustomPreview(Geometry=pipe, Material=ColourSwatch(SwatchColor=RGB(199, 117, 189)))
