# Grasshopper definition voronoi.gh (Grasshopper 1.0.7)

pt = ConstructPoint(XCoordinate=Slider(-22.685, range=-100..100), YCoordinate=Slider(-22.278, range=-100..100), ZCoordinate=0)
pt_2 = ConstructPoint(XCoordinate=Slider(30.355, range=-100..100), YCoordinate=Slider(26.682, range=-100..100), ZCoordinate=0)
box = Box2Pt(PointA=pt, PointB=pt_2, Plane=PlaneXY(0, 0, 0))
Z = UnitZ(Factor=1)
pt_3 = Point([<point referenced from the Rhino model> x26])
extr = Extrude(Base=box, Direction=Z)
Z_2 = UnitZ(Factor=Slider(4.412, range=0..30))
bbox = BoundingBox(Content=extr, Plane=PlaneXY(0, 0, 0))  # -> Box, Box_2
voronoi = Voronoi(Points=pt_3, Boundary=bbox.Box, BruteForceOverride=False)
offset = OffsetCurve(Curve=voronoi, Distance=expr("-X", Slider(0.849, range=0..1)), Plane=PlaneXY(0, 0, 0), Corners=1)
extr_2 = Extrude(Base=voronoi, Direction=Z_2)
extr_3 = Extrude(Base=offset, Direction=Z_2)  # -> flatten(Extrusion)
cap = CapHoles(Brep=extr_2)
cap_2 = CapHoles(Brep=extr_3)
sdiff = SolidDifference(BrepsA=cap, BrepsB=cap_2)
