# Grasshopper definition voronoi2.gh (Grasshopper 1.0.7)

crv = Curve(<curve referenced from the Rhino model>)
srf = Surface(crv)
popgeo = PopulateGeometry(Geometry=srf, Count=Slider(282, range=0..1000), Seed=Slider(101, range=0..1000))
voronoi = Voronoi(Points=popgeo, Boundary=crv, BruteForceOverride=False)
Z = UnitZ(Factor=Slider(4, range=0..100))
extr = Extrude(Base=voronoi, Direction=Z)
